# Grasshopper definition GetElements.gh (Grasshopper 1.0.7)
# plug-ins: Rhino.Inside for Autodesk Revit

visible_in_view_filter = VisibleInViewFilter(View=<view referenced from the Revit model>, Inverted=False)
query_elements = QueryElements(Filter=visible_in_view_filter, Limit=100)  # -> Elements, Count
element_version = ElementVersion(Element=query_elements.Elements)  # -> Editable, Created, Version
guid = Guid(query_elements.Elements)
element_detals = Panel(query_elements.Elements)
guid_2 = Panel(guid)
version_guid = Panel(element_version.Version)
graft_tree = GraftTree(Tree=version_guid, IncludeEmptyLists=True, IncludeNullItems=True)
graft_tree_2 = GraftTree(Tree=element_detals, IncludeEmptyLists=True, IncludeNullItems=True)
graft_tree_3 = GraftTree(Tree=guid_2, IncludeEmptyLists=True, IncludeNullItems=True)
concatenate = Concatenate(FragmentA=graft_tree, FragmentB=graft_tree_2, JoinSeparator=",")
concatenate_2 = Concatenate(FragmentA=concatenate, FragmentB=graft_tree_3, JoinSeparator=",")
panel = Panel(concatenate_2)
